# Grasshopper definition NOC 08 Bouncing Ball.gh (Grasshopper 1.0.7)

trigger = Trigger(Interval=20, TimerInterval=20, Target=addition)  # disabled
addition = Addition(B="1")
rec = DataRecorder(addition, DataLimit=-10, RecordData=True)
number_slider = Slider(0, range=0..1000)
ma = MassAddition(Input=rec)  # -> Result, PartialResults
panel = Panel(ma.Result)
python = GhPythonScript(time=ma.Result)  # -> out, a; inputs time: Int32
# ---------- python: Python ----------
import rhinoscriptsyntax as rs


x = 50
y = 50

xSpeed = 1
ySpeed = 3

upperBounds = 90

for t in range(time):
    x += xSpeed
    y += ySpeed
    
    if x < 0 or x > upperBounds:
        xSpeed *= -1
        
    if y < 0 or y > upperBounds:
        ySpeed *= -1

a = rs.AddSphere([x,y,0],10)
# ---------- end python ----------
